# Grasshopper definition New Scenario-Solar radiation prediction DT.gh (Grasshopper 0.9.76)
# plug-ins: GH_CPython

# ---- group: SOUTH
t1 = ValueList({"Low": "12", "Medium": "28", "High": "44"}, selected="Low")
point = Point(Point(-8, -43, 0))
point_2 = Point(Point(16, -43, 0))
domain_box = DomainBox(Base=[point, point_2], X="19", Y="18", Z=t1)

# ---- group: NORTH
t1_2 = ValueList({"Low": "12", "Medium": "28", "High": "44"}, selected="Medium")
point_3 = Point(Point(-46, 26, 0))
point_4 = Point(Point(-14, 26, 0))
domain_box_2 = DomainBox(Base=[point_4, point_3], X="26", Y="18", Z=t1_2)

# ---- group: EAST
point_5 = Point(Point(27, -12, 0))
point_6 = Point(Point(27, 17, 0))
point_7 = Point(Point(27, 41, 0))
t1_3 = ValueList({"Low": "12", "Medium": "28", "High": "44"}, selected="Low")
domain_box_3 = DomainBox(Base=[point_5, point_6, point_7], X="19", Y="22", Z=t1_3)

# ---- group: WEST
t1_4 = ValueList({"Low": "12", "Medium": "28", "High": "44"}, selected="Low")
point_8 = Point(Point(-45, -45, 0))
point_9 = Point(Point(-45, -16, 0))
domain_box_4 = DomainBox(Base=[point_9, point_8], X="18", Y="22", Z=t1_4)

# ---- group: SOUTH
t1_5 = ValueList({"Low": "12", "Medium": "28", "High": "44"}, selected="Low")
point_10 = Point(Point(35, -74, 0))
point_11 = Point(Point(-8, -74.20650201, 0))
domain_box_5 = DomainBox(Base=[point_11, point_10], X="30", Y="18", Z=t1_5)

# ---- group: EAST
t1_6 = ValueList({"Low": "12", "Medium": "28", "High": "44"}, selected="Medium")
point_12 = Point(Point(86.98437894, -74.20650201, 0))
point_13 = Point(Point(86.98437894, -42.49378955, 0))
domain_box_6 = DomainBox(Base=[point_13, point_12], X="22", Y="18", Z=t1_6)

# ----
point_14 = Point(Point(48.5, 11, 0))
point_15 = Point(Point(48, 38, 0))

# ---- group: NORTH
t1_7 = ValueList({"Low": "12", "Medium": "28", "High": "44"}, selected="High")
point_16 = Point(Point(48, -12, 0))
point_17 = Point(Point(86.98437894, -11.91131159, 0))
domain_box_7 = DomainBox(Base=[point_17, point_16, point_14, point_15], X="15", Y="18", Z=t1_7)

# ---- group: Tower
brep = Brep(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)

# ---- group: Tower -Block3
brep_2 = Brep(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)

# ----
number = Number(t1_4)
number_2 = Number(t1)
number_3 = Number(t1_2)
number_4 = Number(t1_3)
number_5 = Number(t1_6)
number_6 = Number(t1_7)
number_7 = Number(t1_5)

# ---- group: Office - 24 m Height
brep_3 = Brep(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)

# ----
brep_4 = Brep(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)

# ---- group: WEST
t1_8 = ValueList({"Low": "12", "Medium": "28", "High": "44"}, selected="High")
point_18 = Point(Point(-92.30760138, -45, 0))
point_19 = Point(Point(-92.30760138, -74.34172814, 0))
domain_box_8 = DomainBox(Base=[point_18, point_19], X="15", Y="25", Z=t1_8)

# ---- group: NORTH
t1_9 = ValueList({"Low": "12", "Medium": "28", "High": "44"}, selected="Medium")
point_20 = Point(Point(-66, -17, 0))
point_21 = Point(Point(-92.30760138, -17, 0))
domain_box_9 = DomainBox(Base=[point_20, point_21], X="15", Y="25", Z=t1_9)

# ---- group: SOUTH
t1_10 = ValueList({"Low": "12", "Medium": "28", "High": "44"}, selected="Low")
point_22 = Point(Point(-66, -74.73757851, 0))
point_23 = Point(Point(-45, -74.8088926, 0))
domain_box_10 = DomainBox(Base=[point_22, point_23], X="18", Y="18", Z=t1_10)

# ----
brep_5 = Brep(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)

# ---- group: 48 m
brep_6 = Brep(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)

# ----
brep_7 = Brep(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)

facade_level = ValueList({"Low": "0.50", "Medium": "1.00", "High": "1.50"}, selected="High")
avr = Average(Input=[number_2, number_4, number_3, number])
multiplication = Multiplication(A=avr, B=facade_level)
facade_level_height = Panel(multiplication)
moveaway = MoveAwayFrom(Geometry=brep_3, Emitter=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, Distance=multiplication)  # -> Geometry, Transform

# ---- group: Tower block2
brep_8 = Brep(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)

# ----
facade_level_2 = ValueList({"Low": "0.50", "Medium": "1.00", "High": "1.50"}, selected="High")
avr_2 = Average(Input=[number_7, number_5, number_6, number_2])
multiplication_2 = Multiplication(A=avr_2, B=facade_level_2)
facade_level_height_2 = Panel(multiplication_2)
moveaway_2 = MoveAwayFrom(Geometry=brep_6, Emitter=<point referenced from the Rhino model>, Distance=multiplication_2)  # -> Geometry, Transform

number_8 = Number(t1_9)
number_9 = Number(t1_8)
number_10 = Number(t1)
number_11 = Number(t1_10)

# ---- group: 10 M / Surface office
brep_9 = Brep(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)

# ----
facade_level_3 = ValueList({"Low": "0.50", "Medium": "1.00", "High": "1.50"}, selected="Low")
avr_3 = Average(Input=[number_10, number_11, number_9, number_8])
multiplication_3 = Multiplication(A=avr_3, B=facade_level_3)
facade_level_height_3 = Panel(multiplication_3)
moveaway_3 = MoveAwayFrom(Geometry=brep_9, Emitter=<point referenced from the Rhino model>, Distance=multiplication_3)  # -> Geometry, Transform

rep = ReplaceText(Text=facade_level_3, Find="0.50", Replace="1", RecursiveReplace=False)
rep_2 = ReplaceText(Text=t1_8, Find="12", Replace="1", RecursiveReplace=False)
rep_3 = ReplaceText(Text=t1_9, Find="12", Replace="1", RecursiveReplace=False)
rep_4 = ReplaceText(Text=t1_10, Find="12", Replace="1", RecursiveReplace=False)
rep_5 = ReplaceText(Text=t1_4, Find="12", Replace="1", RecursiveReplace=False)
rep_6 = ReplaceText(Text=rep, Find="1.00", Replace="2", RecursiveReplace=False)
rep_7 = ReplaceText(Text=rep_4, Find="28", Replace="2", RecursiveReplace=False)
rep_8 = ReplaceText(Text=rep_2, Find="28", Replace="2", RecursiveReplace=False)
rep_9 = ReplaceText(Text=rep_5, Find="28", Replace="2", RecursiveReplace=False)
rep_10 = ReplaceText(Text=rep_3, Find="28", Replace="2", RecursiveReplace=False)
rep_11 = ReplaceText(Text=rep_6, Find="1.50", Replace="3", RecursiveReplace=False)
rep_12 = ReplaceText(Text=rep_7, Find="44", Replace="3", RecursiveReplace=False)
rep_13 = ReplaceText(Text=rep_10, Find="44", Replace="3", RecursiveReplace=False)
rep_14 = ReplaceText(Text=rep_8, Find="44", Replace="3", RecursiveReplace=False)
rep_15 = ReplaceText(Text=rep_9, Find="44", Replace="3", RecursiveReplace=False)

rep_16 = ReplaceText(Text=facade_level, Find="0.50", Replace="1", RecursiveReplace=False)
rep_17 = ReplaceText(Text=t1_4, Find="12", Replace="1", RecursiveReplace=False)
rep_18 = ReplaceText(Text=t1_2, Find="12", Replace="1", RecursiveReplace=False)
rep_19 = ReplaceText(Text=t1, Find="12", Replace="1", RecursiveReplace=False)
rep_20 = ReplaceText(Text=t1_3, Find="12", Replace="1", RecursiveReplace=False)
rep_21 = ReplaceText(Text=rep_16, Find="1.00", Replace="2", RecursiveReplace=False)
rep_22 = ReplaceText(Text=rep_19, Find="28", Replace="2", RecursiveReplace=False)
rep_23 = ReplaceText(Text=rep_17, Find="28", Replace="2", RecursiveReplace=False)
rep_24 = ReplaceText(Text=rep_20, Find="28", Replace="2", RecursiveReplace=False)
rep_25 = ReplaceText(Text=rep_18, Find="28", Replace="2", RecursiveReplace=False)
rep_26 = ReplaceText(Text=rep_21, Find="1.50", Replace="3", RecursiveReplace=False)
rep_27 = ReplaceText(Text=rep_22, Find="44", Replace="3", RecursiveReplace=False)
rep_28 = ReplaceText(Text=rep_25, Find="44", Replace="3", RecursiveReplace=False)
rep_29 = ReplaceText(Text=rep_23, Find="44", Replace="3", RecursiveReplace=False)
rep_30 = ReplaceText(Text=rep_24, Find="44", Replace="3", RecursiveReplace=False)

rep_31 = ReplaceText(Text=facade_level_2, Find="0.50", Replace="1", RecursiveReplace=False)
rep_32 = ReplaceText(Text=t1, Find="12", Replace="1", RecursiveReplace=False)
rep_33 = ReplaceText(Text=t1_7, Find="12", Replace="1", RecursiveReplace=False)
rep_34 = ReplaceText(Text=t1_5, Find="12", Replace="1", RecursiveReplace=False)
rep_35 = ReplaceText(Text=t1_6, Find="12", Replace="1", RecursiveReplace=False)
rep_36 = ReplaceText(Text=rep_31, Find="1.00", Replace="2", RecursiveReplace=False)
rep_37 = ReplaceText(Text=rep_34, Find="28", Replace="2", RecursiveReplace=False)
rep_38 = ReplaceText(Text=rep_32, Find="28", Replace="2", RecursiveReplace=False)
rep_39 = ReplaceText(Text=rep_35, Find="28", Replace="2", RecursiveReplace=False)
rep_40 = ReplaceText(Text=rep_33, Find="28", Replace="2", RecursiveReplace=False)
rep_41 = ReplaceText(Text=rep_36, Find="1.50", Replace="3", RecursiveReplace=False)
rep_42 = ReplaceText(Text=rep_37, Find="44", Replace="3", RecursiveReplace=False)
rep_43 = ReplaceText(Text=rep_40, Find="44", Replace="3", RecursiveReplace=False)
rep_44 = ReplaceText(Text=rep_38, Find="44", Replace="3", RecursiveReplace=False)
rep_45 = ReplaceText(Text=rep_39, Find="44", Replace="3", RecursiveReplace=False)

merge = Merge(Data1=domain_box, Data2=domain_box_3, Data3=domain_box_2, Data4=domain_box_4)  # -> graft(Result)
merge_2 = Merge(Data1=domain_box_5, Data2=domain_box_6, Data3=domain_box_7, Data4=domain_box)  # -> graft(Result)

# ---- group: context buildings block 1
brep_10 = Brep(merge)

# ----
merge_3 = Merge(Data1=domain_box_10, Data2=domain_box_8, Data3=domain_box_9, Data4=domain_box_4)  # -> graft(Result)
brep_11 = Brep(merge_2)
brep_12 = Brep(Tree({0;0}: [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], {0;1}: [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], {0;2}: [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], {0;3}: [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], {0;4}: [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], {0;5}: [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], {0;6}: [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], {0;7}: [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], {0;8}: [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], {0;9}: [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]))

# ---- group: Building Contexts - block 2
brep_13 = Brep(merge_3)

# ----
number_slider = Slider(0, range=0..2)

# ---- group: Office Facade
list_item = ListItem(List=[moveaway.Geometry, moveaway_3.Geometry, moveaway_2.Geometry], Index=number_slider, Wrap=True)

# ---- group: Building Context Block
list_item_2 = ListItem(List=[brep_10, brep_13, brep_12, brep_11], Index=number_slider, Wrap=True)

# ----
brep_14 = Brep([<brep referenced from the Rhino model> x3])
edges = BrepEdges(Brep=[brep, brep_8, brep_2])  # -> Naked, Interior, NonManifold
edges_2 = BrepEdges(Brep=[brep_10, brep_13, brep_14, list_item_2, brep_12])  # -> Naked, Interior, NonManifold
brep_15 = Brep([<brep referenced from the Rhino model> x6])
preview = CustomPreview(Geometry=[brep, brep_8, brep_2], Shader=ColourSwatch(SwatchColor=RGBA(186, 124, 0, 64)))
preview_2 = CustomPreview(Geometry=[brep_10, brep_13, brep_12, brep_14, list_item_2], Shader=ColourSwatch(SwatchColor=RGBA(168, 168, 168, 143)))
preview_3 = CustomPreview(Geometry=[edges_2.Naked, edges_2.Interior], Shader=ColourSwatch(SwatchColor=RGB(0, 0, 0)))
preview_4 = CustomPreview(Geometry=brep_15, Shader=ColourSwatch(SwatchColor=RGBA(191, 191, 191, 104)))
preview_5 = CustomPreview(Geometry=[edges.Naked, edges.Interior], Shader=ColourSwatch(SwatchColor=RGB(0, 0, 0)))
edges_3 = BrepEdges(Brep=brep_15)  # -> Naked, Interior, NonManifold
preview_6 = CustomPreview(Geometry=[edges_3.Naked, edges_3.Interior], Shader=ColourSwatch(SwatchColor=RGB(0, 0, 0)))

square = Square(Plane=list_item, Size=Slider(0.8, range=0..1), ExtentX=5, ExtentY=5)  # -> Cells, Points
area = Area(Geometry=square.Cells)  # -> Area, Centroid
deconstruct = Deconstruct(Point=area.Centroid)  # -> XComponent, YComponent, ZComponent
construct_point = ConstructPoint(XCoordinate=deconstruct.XComponent, YCoordinate=deconstruct.YComponent, ZCoordinate=deconstruct.ZComponent)  # -> flatten(Point)
panel = Panel(construct_point)

# ---- group: Tower2 / X,Y,Z
data = Data(["{56.288624, -43.01, 39.599998}", "{56.288624, -43.01, 38.800003}", "{56.288624, -43.01, 38.0}", "{56.288624, -43.01, 37.199997}", "{56.288624, -43.01, 36.400002}", "{57.088627, -43.01, 39.599998}", "{57.088627, -43.01, 38.800003}", "{57.088627, -43.01, 38.0}", "{57.088627, -43.01, 37.199997}", "{57.088627, -43.01, 36.400002}", "{57.88863, -43.01, 39.599998}", "{57.88863, -43.01, 38.800003}", "{57.88863, -43.01, 38.0}", "{57.88863, -43.01, 37.199997}", "{57.88863, -43.01, 36.400002}", "{58.688629, -43.01, 39.599998}", "{58.688629, -43.01, 38.800003}", "{58.688629, -43.01, 38.0}", "{58.688629, -43.01, 37.199997}", "{58.688629, -43.01, 36.400002}", "{59.488625, -43.01, 39.599998}", "{59.488625, -43.01, 38.800003}", "{59.488625, -43.01, 38.0}", "{59.488625, -43.01, 37.199997}", "{59.488625, -43.01, 36.400002}"])

# ---- group: Tower1 / X,Y,Z
data_2 = Data(["{-57.400002, -45.01, 15.6}", "{-57.400002, -45.01, 14.8}", "{-57.400002, -45.01, 14.0}", "{-57.400002, -45.01, 13.200001}", "{-57.400002, -45.01, 12.4}", "{-58.199997, -45.01, 15.6}", "{-58.199997, -45.01, 14.8}", "{-58.199997, -45.01, 14.0}", "{-58.199997, -45.01, 13.200001}", "{-58.199997, -45.01, 12.4}", "{-59.0, -45.01, 15.6}", "{-59.0, -45.01, 14.8}", "{-59.0, -45.01, 14.0}", "{-59.0, -45.01, 13.200001}", "{-59.0, -45.01, 12.4}", "{-59.799999, -45.01, 15.6}", "{-59.799999, -45.01, 14.8}", "{-59.799999, -45.01, 14.0}", "{-59.799999, -45.01, 13.200001}", "{-59.799999, -45.01, 12.4}", "{-60.599998, -45.01, 15.6}", "{-60.599998, -45.01, 14.8}", "{-60.599998, -45.01, 14.0}", "{-60.599998, -45.01, 13.200001}", "{-60.599998, -45.01, 12.4}"])

# ---- group: Tower0 / X,Y,Z
data_3 = Data(["{-1.0, -13.077238, 24.4}", "{-0.2, -13.077238, 24.4}", "{0.6, -13.077238, 24.4}", "{1.4, -13.077238, 24.4}", "{2.2, -13.077238, 24.4}", "{-1.0, -13.077238, 25.200001}", "{-0.2, -13.077238, 25.200001}", "{0.6, -13.077238, 25.200001}", "{1.4, -13.077238, 25.200001}", "{2.2, -13.077238, 25.200001}", "{-1.0, -13.077238, 26.0}", "{-0.2, -13.077238, 26.0}", "{0.6, -13.077238, 26.0}", "{1.4, -13.077238, 26.0}", "{2.2, -13.077238, 26.0}", "{-1.0, -13.077238, 26.800001}", "{-0.2, -13.077238, 26.800001}", "{0.6, -13.077238, 26.800001}", "{1.4, -13.077238, 26.800001}", "{2.2, -13.077238, 26.800001}", "{-1.0, -13.077238, 27.599998}", "{-0.2, -13.077238, 27.599998}", "{0.6, -13.077238, 27.599998}", "{1.4, -13.077238, 27.599998}", "{2.2, -13.077238, 27.599998}"])

# ----
month = Slider(3, range=1..4, expression="x*3")
orientation = Slider(0, range=0..3)
hours = Slider(7, range=7..18)

hour = Slider(12, range=0..100)
hour_2 = Slider(15, range=0..100)

# ---- group: Tower1 / Simulated SR Results
data_4 = Data(["0.847685", "0.847685", "0.847685", "0.847685", "0.847685", "0.847685", "0.847685", "0.847685", "0.845051", "0.845051", "0.847685", "0.845051", "0.845051", "0.845051", "0.845051", "0.845051", "0.845051", "0.845051", "0.845051", "0.845051", "0.838913", "0.838913", "0.838913", "0.832847", "0.832847"])

# ---- group: Tower0 / Simulated SR Results
# Inputs: Hour
# B00
# B01
# B02
# B03
# Month
# Facade Floor Level
# Orientation
# Facade Level Height
# X
# Y
# Z
data_5 = Data(["0.21782", "0.21782", "0.21782", "0.21782", "0.21782", "0.21782", "0.21782", "0.21782", "0.21782", "0.21782", "0.21782", "0.21782", "0.21782", "0.21782", "0.21782", "0.21782", "0.21782", "0.21782", "0.21782", "0.21782", "0.21782", "0.21782", "0.21782", "0.21782", "0.21782"])

# ---- group: Tower2 / Simulated SR Results
data_6 = Data(["0.578379", "0.578379", "0.578379", "0.578379", "0.578379", "0.578379", "0.578379", "0.578379", "0.578379", "0.578379", "0.578379", "0.578379", "0.578379", "0.578379", "0.578379", "0.578379", "0.578379", "0.578379", "0.578379", "0.578379", "0.578379", "0.578379", "0.578379", "0.578379", "0.578379"])

# ---- group: Inputs
data_7 = Data([hours, rep_29, rep_27, rep_30, rep_28, month, rep_26, orientation, facade_level_height, data_3])

data_8 = Data([hour_2, rep_44, rep_42, rep_45, rep_43, month, rep_41, orientation, facade_level_height_2, data])

data_9 = Data([hour, rep_14, rep_12, rep_15, rep_13, month, rep_11, orientation, facade_level_height_3, data_2])

# ----
merge_4 = Merge(Data1=data_7, Data2=data_9, Data3=data_8)
inputs = Panel(merge_4)

# ---- group: DT Prediction Solar Radiation
gh_cpython = GH_CPython(input=inputs)  # -> output, heat_map; inputs input: list
# ---------- gh_cpython: Python ----------
# -*- coding: utf-8 -*-
""" 
Python Script
Created on  Thursday March 2021 11:50:06 
@author:  iist 

[desc]
Description of the plugin Here
Write here any thing... 
[/desc]

ARGUMENTS:
----------
<inp> 
    _input :[required] - [type = int] - [default = None] 
    Descripe your input here 
        * bullet point.
        * bullet point
</inp>
<inp>
    Other inputs go here ...
</inp>

RETURN:
----------
    <out>
        output_ : indicate your output description here. \n refers to a new line.
    </out>

"""

#!/usr/bin/env python
# coding: utf-8

# # Importing the required python libraries
# 
# 

# In[1]:



import pandas as pd
import numpy as np
import time
import matplotlib.pyplot as plt 
import seaborn as sb # used to plot the heatmap
import pickle
from sklearn.preprocessing import OneHotEncoder
from sklearn.tree import DecisionTreeRegressor  
from sklearn.ensemble import RandomForestRegressor
from sklearn.metrics import mean_squared_error, mean_absolute_error, r2_score

start1 = time.perf_counter()

# # Data loading and preprocessing

# In[2]:


# The data is read as a pandas data frame
data = pd.read_csv("C:/Users/iist/Documents/asif/project/New folder/finalized_data.csv").dropna()


# In[3]:

def data_create(_inp):
    test_dat=np.zeros((25,13))
    tmp = np.tile(_inp[0],(25)) 
    test_dat[:,0] = tmp
    tmp = np.tile(_inp[1],(25))
    test_dat[:,1] = tmp
    tmp = np.tile(_inp[2],(25))
    test_dat[:,2] = tmp
    tmp = np.tile(_inp[3],(25))
    test_dat[:,3] = tmp
    tmp = np.tile(_inp[4],(25))
    test_dat[:,4] = tmp
    tmp = np.tile(_inp[5],(25))
    test_dat[:,5] = tmp
    tmp = np.tile(_inp[6],(25))
    test_dat[:,6] = tmp
    tmp = np.tile(_inp[7],(25))
    test_dat[:,7] = tmp
    tmp = np.tile(_inp[8],(25))
    test_dat[:,8] = tmp

    for i in range(9,34):
        tmp =list(_input[i])  
        tmp = np.asarray(tmp)
        tmp = np.reshape(tmp,(1,tmp.shape[0]))
        test_dat[i-9,9:12] = tmp
    return test_dat


# In[ ]:
 
n = len(_input)/34
test_data=np.zeros((0,13))
start=0
for i in range(int(n)):
    T = data_create(_input[start:start+34])
    test_data = np.concatenate((test_data,T),axis=0)
    start = start+34

 
test_data = pd.DataFrame(test_data, columns=[str(i) for i in range(13)]) 


# In[ ]:


dat = test_data.values
new_dat = np.zeros((test_data.shape[0], test_data.shape[1]))

for i in range(int(n)):
    cur = dat[i*25,:] 
    D = data[data['0'] == int(cur[0])]
    if D.shape[0]!=0:
     
        D = D[D['1'] == cur[1]] 
        
        D = D[D['2'] == cur[2]] 
        
        D = D[D['3'] == cur[3]] 
        
        D = D[D['4'] == cur[4]] 
        
        D = D[D['5'] == cur[5]] 
        
        D = D[D['6'] == cur[6]] 
        
        D = D[D['7'] == cur[7]] 

        D = D[D['8'] == cur[8]] 
        
    
    D = D.values
 
    test_data.iloc[i*25:(i+1)*25,9:12] = D[:,9:12]
                


# In[ ]:


# Array that specifies which columns are categorical inputs
categorical_features = ["0", "1", "2", "3", "4","5", "6", "7", "8"] # Except column "7", all are label encoded and "7" is 
                                                               # one-hot encoded. 
# Array that specifies which columns are continuous inputs
contnuous_features = ["9","10","11"]
output_feature = "12"  # specifies which column is output


temp={}
label_encoders = {} 
# for loop starts for label encoding
for i in range(0,len(categorical_features)): 
    #codes for one-hot encoding
    label_encoders[categorical_features[i]] = OneHotEncoder(handle_unknown='ignore')
    label_encoders[categorical_features[i]].fit(data[categorical_features[i]].values.reshape(-1,1))
    temp[categorical_features[i]]=label_encoders[categorical_features[i]].transform(test_data[categorical_features[i]].values.reshape(-1,1)).toarray() 


# In[ ]:


ind=13
new_categorical_features=[]
for i in range(0,len(categorical_features)):
    for j in range(0,temp[categorical_features[i]].shape[1]):
        test_data[str(ind)] = temp[categorical_features[i]][:,j]
        new_categorical_features.append(str(ind)) # Stroing the column identity of newly added one-hot encoded columns as 
                                                  # categorical input.
        ind=ind+1
    test_data=test_data.drop([categorical_features[i]], axis=1) # The old column is deleted from the data


# In[ ]:


test_data = test_data.values
test_data_new=test_data[:,0:3]
test_data = np.concatenate((test_data_new, test_data[:,4:]),axis=1) 


# In[ ]:


filename = 'C:/Users/iist/Documents/asif/project/New folder//DT_finalized_model.sav'
loaded_model = pickle.load(open(filename, 'rb'))
y_pred = loaded_model.predict(test_data)
y_pred=y_pred.reshape(y_pred.shape[0],1) # Reshaping y_pred for visualization
#output_ = y_pred


output_=[]
# In[ ]:
for i in range(int(n)):
    output_.append(y_pred[i*25:(i+1)*25,:])

end = time.perf_counter()
print(f"Program running time is {end-start1}")
#plt.figure(figsize=(5,4))
#for i in range(int(n)):
#    predict=output_[i]
#    predict=np.reshape(predict,(5,5))
#    plt.subplot(int(n),1,i+1)
#    sb.heatmap(predict, vmin = 0, vmax = 1.30141, cmap="OrRd_r",annot=True)
#plt.show()
# ---------- end gh_cpython ----------

# ----
predicted_results_dt = Panel(gh_cpython.output)
partition_list = PartitionList(List=predicted_results_dt, Size=Slider(25, range=0..100))
panel_2 = Panel(partition_list)
